# Grasshopper definition GettingStartedStaticDynamics.ghx (Grasshopper 0.8.10)

cir = Circle(Plane=PlaneXY(0, 0, 0), Radius=10)
pln = Plane(Plane(origin=(0, 0, 0), x=(-0.6014765672, 0.7988904425, 0), y=(-0.08891721156, -0.06694487295, 0.9937867545)))
spm_static = StaticSettings(
    StepCount=Slider(52, range=0..101),
    Tolerance=0,
    Stop=False,
    WindingStopAngle=0,
    InterpolationRadius=0,
    SnappingTolerance=0,
    SnappingMinimumAngle=0,
    TensorField=False,
    LineContinuity=False,
    ScaleFactor=expr("1", 0.5))
divide = DivideCurve(Curve=cir, Number=101, Kinks=False)  # -> Points, Tangents, Parameters
vortex = VortexDynamic(Plane=pln, Exponent=1, Factor=1, RotationalFactor=1, Exact=False, Funnel=False, Reverse=False, Accelerated=False)
vfi = VectorFieldIntegration(TravellingPoint=divide.Points, Dynamics=vortex, Settings=spm_static)  # -> TravelledPoints, TravelledVectors
crv = Curve(Vertices=vfi.TravelledPoints, Degree=3, Periodic=False)  # -> Curve, Length, Domain
