# Grasshopper definition GettingStartedDynamicIntegrator.ghx (Grasshopper 0.8.10)

cir = Circle(Plane=PlaneXY(0, 0, 0), Radius=10)
pln = Plane(Plane(origin=(0, 0, 0), x=(-0.6014765672, 0.7988904425, 0), y=(-0.08891721156, -0.06694487295, 0.9937867545)))
spm_dynamic = DynamicSettings(
    Respawn=False,
    NewSpawnStepCount=25,
    RandomizeNewSpawn=12,
    InterpolationRadius=0,
    SnappingTolerance=0,
    SnappingMinimumAngle=0,
    LineContinuity=False,
    ScaleFactor=1)
divide = DivideCurve(Curve=cir, Number=101, Kinks=False)  # -> Points, Tangents, Parameters
vortex = VortexDynamic(Plane=pln, Exponent=2, Factor=1, RotationalFactor=1, Exact=False, Funnel=False, Reverse=False, Accelerated=False)
timer = Timer(TimerInterval=33, Target=vfis)
vfis = DynamicVectorFieldIntegrationSimulation(StartPoints=divide.Points, ParticleLifeTime=500, Dynamics=vortex, Settings=spm_dynamic, ResetSimulation=Toggle(True))  # -> TravelledPoints, TravelledVectors
